# Grasshopper definition Dijkstra_Algorithm.gh (Grasshopper 1.0.7)
# Copyright: Job de Vogel
# plug-ins: karambaGH

gridsize = Slider(5, range=0..20)
gridsteps = Slider(10, range=0..20)
series = Series(Start=0, Step=gridsize, Count=gridsteps)
negative = Negative(Value=gridsize)
square = Square(Plane=PlaneXY(0, 0, 0), Size=gridsize, ExtentX=expr("x-1", gridsteps), ExtentY=expr("x-1", gridsteps))  # -> Cells, Points
construct_domain = ConstructDomain(DomainStart=0, DomainEnd=expr("x*x*x", gridsteps))
unit_z = UnitZ(Factor=series)
construct_domain_2 = ConstructDomain(DomainStart=expr("x/2 +1", negative), DomainEnd=expr("x/2 -1", gridsize))
random = Random(Range=construct_domain, Number=Slider(0, range=0..1000), Seed=2, Integers=True)
move = Move(Geometry=graft(square.Points), Motion=unit_z)  # -> flatten(Geometry), Transform
domain_box = DomainBox(Base=PlaneXY(0, 0, 0), X=construct_domain_2, Y=construct_domain_2, Z=construct_domain_2)
data_dam = DataDam(BufferDelay=10000000, BufferMode=0)
mesh_brep = MeshBrep(
    Brep=domain_box,
    Settings={GridMaxCount=0, GridMinCount=16, JaggedSeams=False, MaxEdgeLength=0, MinEdgeLength=0.0001, MinTolerance=0, Refine=True, RefineAngle=0, RelativeTolerance=0.65, SimplePlanes=True, Tolerance=0})
cull_index = CullIndex(List=move.Geometry, Indices=random, Wrap=True)
closest_points = ClosestPoints(Point=graft(data_dam), Cloud=data_dam, Count=expr("x+1", Slider(5, range=0..10)))  # -> ClosestPoint, CPIndex, Distance
volume = Volume(Geometry=mesh_brep)  # -> Volume, Centroid
proximity_3d = Proximity3D(Points=cull_index, Group=5, MaxRadius=Slider(5, range=0..10))  # -> Links, simplify(Topology)
smaller_than = SmallerThan(FirstNumber=closest_points.Distance, SecondNumber=Slider(6, range=0..10))  # -> SmallerThan, OrEqualTo
vector_2pt = Vector2Pt(PointA=volume.Centroid, PointB=cull_index, Unitize=False)  # -> Vector, Length
construct_domain_3 = ConstructDomain(DomainStart=0, DomainEnd=1)
closest_points_karamba3d = ClosestPointsKaramba3D(Point=cull_index, Cloud=cull_index, NumberOfNeighbors=Slider(7, range=0..10), LimitDistance=expr("x+x/10", gridsize))  # -> Points, Index, Distance
list_item = ListItem(List=cull_index, Index=proximity_3d.Topology, Wrap=True)
graft_tree = GraftTree(Tree=cull_index, IncludeEmptyLists=True, IncludeNullItems=True)
move_2 = Move(Geometry=domain_box, Motion=vector_2pt.Vector)  # -> Geometry, Transform
curve = Curve(proximity_3d.Links)
cull_pattern = CullPattern(List=closest_points.Distance, CullPattern=smaller_than.OrEqualTo)
cull_pattern_2 = CullPattern(List=closest_points.CPIndex, CullPattern=smaller_than.OrEqualTo)
distance = Distance(PointA=simplify(list_item), PointB=simplify(graft_tree))
cull_index_2 = CullIndex(List=cull_pattern, Indices=0, Wrap=True)  # -> simplify(Distance)
cull_index_3 = CullIndex(List=cull_pattern_2, Indices=0, Wrap=True)  # -> simplify(CPIndex)
item_index = ItemIndex(List=data_dam, Item=data_dam)  # -> simplify(Index)
cull_index_4 = CullIndex(List=closest_points_karamba3d.Index, Indices=0, Wrap=True)  # -> simplify(List)
cull_index_5 = CullIndex(List=closest_points_karamba3d.Distance, Indices=0, Wrap=True)  # -> simplify(List)
list_length = ListLength(List=cull_index)
distance_cp = Data(distance)
index = Integer(proximity_3d.Topology)
cp_point = Point(list_item)
series_2 = Series(Start=0, Step=1, Count=list_length)  # -> simplify(Series)
number_slider = Slider(575, range=0..1000)
gene_pool = GenePool(
    Decimals=0,
    Maximum=500,
    Minimum=0,
    Value=[423.3611966, 438.2080813, 444.3433229, 131.8703343, 9.872428845, 420.6558279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])
ghpython_script = GhPythonScript(Points=item_index, CP_Indices=cull_index_3, Distances=cull_index_2)  # -> graph; inputs Points: list of Int32, CP_Indices: tree of Int32, Distances: tree
# ---------- ghpython_script: Python ----------
__author__ = "Job de Vogel"
__version__ = "2020.10.30"

import rhinoscriptsyntax as rs
import ghpythonlib.treehelpers as th

points = Points
closest_points = th.tree_to_list(CP_Indices , None)
distances = th.tree_to_list(Distances, None)

graph = {}

for pt in points:
    dict = {}
    for i, CP in enumerate(closest_points[pt]):
        dict[CP] = distances[pt][i]
    graph[pt] = dict

graph = str(graph)
# ---------- end ghpython_script ----------
substrate = Substrate(Border={Plane=PlaneXY(0, 0, 0), Size=Domain2(u=0..20, v=0..5)}, Count=100, Angles=[0.1, 0.3, 0.5], Deviation=0, Seed=5)
number_slider_2 = Slider(1687, range=0..3374)  # disabled
graphization = GhPythonScript(Points=series_2, CP_Indices=cull_index_4, Distances=cull_index_5)  # -> graph; inputs Points: list of Int32, CP_Indices: tree of Int32, Distances: tree
# ---------- graphization: Python ----------
__author__ = "Job de Vogel"
__version__ = "2020.10.30"

import rhinoscriptsyntax as rs
import ghpythonlib.treehelpers as th

points = Points
closest_points = th.tree_to_list(CP_Indices , None)
distances = th.tree_to_list(Distances, None)

graph = {}

for pt in points:
    dict = {}
    for i, CP in enumerate(closest_points[pt]):
        dict[CP] = distances[pt][i]
    graph[pt] = dict

print(graph)
graph = str(graph)
# ---------- end graphization ----------
colour_rgb = ColourRGB(Alpha=Slider(61, range=0..255), Red=Slider(0, range=0..255), Green=0, Blue=0)
colour_rgb_2 = ColourRGB(Alpha=Slider(34, range=0..255), Red=0, Green=0, Blue=0)
cull_index_6 = CullIndex(List=move_2.Geometry, Indices=[number_slider, gene_pool], Wrap=True)
list_item_2 = ListItem(List=move_2.Geometry, Index=[number_slider, gene_pool], Wrap=True)
boolean_toggle = BooleanToggle(True)  # disabled
dijkstra = GhPythonScript(graph=graphization, StartIndex=gene_pool, GoalIndex=number_slider, Parallel=Toggle(True))  # -> ShortestPath_indices; inputs StartIndex: list of Int32, GoalIndex: Int32, Parallel: Boolean
# ---------- dijkstra: Python ----------
import ghpythonlib.treehelpers as th
import ghpythonlib.parallel as parallel
import copy

graph = eval(graph) ##input from Grasshopper
goal = GoalIndex    ##input from Grasshopper

def dijkstra(start):
    shortest_distance = {}
    predecessor = {}
    unseenNodes = copy.deepcopy(graph)
    infinity = float("inf")
    path = []
    
    for node in unseenNodes:
        shortest_distance[node] = infinity
    
    shortest_distance[start] = 0
    
    while unseenNodes:
        minNode = None
        
        for node in unseenNodes:
            if minNode is None:
                minNode = node
            elif shortest_distance[node] < shortest_distance[minNode]:
                minNode = node
                
        for childNode, weight in graph[minNode].items():
            if weight + shortest_distance[minNode] < shortest_distance[childNode]:
                shortest_distance[childNode] = weight + shortest_distance[minNode]
                predecessor[childNode] = minNode
        
        unseenNodes.pop(minNode)
    
    currentNode = goal
    
    while currentNode != start:
        try:
            path.insert(0, currentNode)
            currentNode = predecessor[currentNode]
        except KeyError:
            ShortestPath_polyline = "Path not reachable"
            ShortestPath_indices = "Path not reachable"
            break
    path.insert(0, start)

    return path

if Parallel:
    paths = parallel.run(dijkstra, StartIndex, False)
    ShortestPath_indices = th.list_to_tree(paths, True, [0])
else:
    paths = []
    for index in StartIndex:
        paths.append(dijkstra(index))
    ShortestPath_indices = th.list_to_tree(paths, True, [0])
# ---------- end dijkstra ----------
custom_preview = CustomPreview(Geometry=list_item_2, Material=colour_rgb)
custom_preview_2 = CustomPreview(Geometry=cull_index_6, Material=colour_rgb_2)
ghpython_script_2 = GhPythonScript(graph=ghpython_script, GoalIndex=number_slider_2, Parallel=boolean_toggle)  # -> ShortestPath_indices; inputs StartIndex: list of Int32, x: list of Int32, GoalIndex: Int32, Parallel: Boolean; disabled
# ---------- ghpython_script_2: Python ----------
import ghpythonlib.treehelpers as th
import ghpythonlib.parallel as parallel
import copy

graph = eval(graph) ##input from Grasshopper
goal = GoalIndex    ##input from Grasshopper

def dijkstra(start):
    shortest_distance = {}
    predecessor = {}
    unseenNodes = copy.deepcopy(graph)
    infinity = float("inf")
    path = []
    
    for node in unseenNodes:
        shortest_distance[node] = infinity
    
    shortest_distance[start] = 0
    
    while unseenNodes:
        minNode = None
        
        for node in unseenNodes:
            if minNode is None:
                minNode = node
            elif shortest_distance[node] < shortest_distance[minNode]:
                minNode = node
                
        for childNode, weight in graph[minNode].items():
            if weight + shortest_distance[minNode] < shortest_distance[childNode]:
                shortest_distance[childNode] = weight + shortest_distance[minNode]
                predecessor[childNode] = minNode
        
        unseenNodes.pop(minNode)
    
    currentNode = goal
    
    while currentNode != start:
        try:
            path.insert(0, currentNode)
            currentNode = predecessor[currentNode]
        except KeyError:
            ShortestPath_polyline = "Path not reachable"
            ShortestPath_indices = "Path not reachable"
            break
    path.insert(0, start)

    return path

if Parallel:
    paths = parallel.run(dijkstra, x, False)
    ShortestPath_indices = th.list_to_tree(paths, True, [0])
else:
    paths = []
    for index in x:
        paths.append(dijkstra(index))
    ShortestPath_indices = th.list_to_tree(paths, True, [0])
# ---------- end ghpython_script_2 ----------
panel = Panel(ghpython_script_2)  # disabled
number_slider_3 = Slider(162, range=0..255)
curve_drawer = GhPythonScript(PointCloud=cull_index, ShortestPath_indices=dijkstra)  # -> Path; inputs PointCloud: list of Point3d, ShortestPath_indices: list of Int32
# ---------- curve_drawer: Python ----------
import rhinoscriptsyntax as rs
import ghpythonlib as gh

PC = PointCloud
SPI = ShortestPath_indices

points = []

def CreatePolyline(PC, SPI):
    for int in ShortestPath_indices:
        points.append(PC[int])
    return points

Path = rs.AddPolyline(CreatePolyline(PC, SPI))
# ---------- end curve_drawer ----------
ghpython_script_3 = GhPythonScript(PointCloud=data_dam, ShortestPath_indices=ghpython_script_2)  # -> out, a; inputs PointCloud: list of Point3d, ShortestPath_indices: list of Int32; disabled
# ---------- ghpython_script_3: Python ----------
import rhinoscriptsyntax as rs
import ghpythonlib as gh

PC = PointCloud
SPI = ShortestPath_indices

points = []

def CreatePolyline(PC, SPI):
    for int in ShortestPath_indices:
        points.append(PC[int])
    return points

a = rs.AddPolyline(CreatePolyline(PC, SPI))
# ---------- end ghpython_script_3 ----------
colour_rgb_3 = ColourRGB(Alpha=Slider(255, range=0..255), Red=number_slider_3, Green=number_slider_3, Blue=number_slider_3)
pipe = Pipe(Curve=curve_drawer, Radius=0.5, Caps=2)
pipe_2 = Pipe(Curve=ghpython_script_3.a, Radius=1, Caps=2)  # disabled
mesh_brep_2 = MeshBrep(
    Brep=pipe,
    Settings={GridMaxCount=0, GridMinCount=16, JaggedSeams=False, MaxEdgeLength=0, MinEdgeLength=0.0001, MinTolerance=0, Refine=True, RefineAngle=0, RelativeTolerance=0.65, SimplePlanes=True, Tolerance=0})
custom_preview_3 = CustomPreview(
    Geometry=pipe_2,
    Material={diffuse=RGB(221, 160, 221), emission=RGB(66, 48, 66), shine=0.5, specular=RGB(255, 255, 255), transparency=0})  # disabled
custom_preview_4 = CustomPreview(Geometry=mesh_brep_2, Material=colour_rgb_3)
ghpython_script_4 = GhPythonScript()  # -> graph; inputs PointCloud: list of Point3d, GridSize: Int32, Dimensions: Int32; disabled
# ---------- ghpython_script_4: Python ----------
import rhinoscriptsyntax as rs
import ghpythonlib.components as gh

PC = PointCloud
GS = GridSize
Dim = Dimensions

ar = [1, 2]
ar1 = [1, 2]
""""
#print(PC)
def add():
    for pt in range(0, len(PC)):
        print(PC[pt])

#add()

def childCoordinates(PC):
    list = []
    for num, pt in enumerate(PC):
        childs = []
        opt = [-GS, GS]
        for x in opt:
            for y in opt:
                pt[0] += x
                pt[1] += y
                print(pt)


childCoordinates(PC)
""""

"""
def neighbours(PC, GS, Dim):
    graph = {}
    for point in PC:
        coordinates = rs.PointCoordinates(point)
"""
"""
def neighbours(PC, GS, Dim):
    nb = {} #list of all neighbours
    graph = {}
    for point in range(0, len(PC)):
        #find all data
        Dict = {}
        pt = rs.AddPoint(PC[point])
        print(pt)
        Neighbours_index = rs.PointArrayClosestPoint(pt, PC)
        #Neighbours_index = gh.ClosestPoints(PC[point], PC, Dim)[1]
        Neighbours_dis = gh.ClosestPoints(PC[point], PC, Dim)[2]

        for num in range(0, len(Neighbours_dis)):
            if Neighbours_dis[num] == GS:
                Dict[Neighbours_index[num]] = Neighbours_dis[num]
        nb[point] = Dict
        
    return nb

graph = str(neighbours(PC, GS, Dim))
"""
# ---------- end ghpython_script_4 ----------
ghpython_script_5 = GhPythonScript(Gridsize=5, count=Slider(5, range=0..10))  # -> graph; inputs PointCloud: list of Point3d, Gridsize: Int32, count: Int32; disabled
# ---------- ghpython_script_5: Python ----------
from rhinoscriptsyntax import PointArrayClosestPoint
from rhinoscriptsyntax import Distance


graph = {}
for i, pt in enumerate(PointCloud):
    ClosestPoints = {}
    PointCloud_temp = PointCloud[:]

    for j in range(0, count):
        CP_index = PointArrayClosestPoint(PointCloud_temp, pt)
        CP_distance = Distance(PointCloud_temp[CP_index], pt)

        index = PointCloud.index(PointCloud_temp[CP_index])

        if CP_distance == Gridsize:           #add <= if smaller then a specific distance
            ClosestPoints[index] = Gridsize

        PointCloud_temp.pop(CP_index)
    graph[i] = ClosestPoints

graph = str(graph)

#next step: make this parallel processing
# ---------- end ghpython_script_5 ----------
data_dam_2 = DataDam(DataDataA=ghpython_script_5, BufferDelay=10000000, BufferMode=0)
ghpython_script_6 = GhPythonScript(graph=ghpython_script_4)  # -> ShortestPath_indices; inputs StartIndex: Int32, GoalIndex: Int32; disabled
# ---------- ghpython_script_6: Python ----------
graph = eval(graph)
start = StartIndex
goal = GoalIndex

def dijkstra(graph, start, goal):
    shortest_distance = {}
    predecessor = {}
    unseenNodes = graph
    infinity = float("inf")
    path = []
    
    for node in unseenNodes:
        shortest_distance[node] = infinity
    
    shortest_distance[start] = 0
    
    while unseenNodes:
        minNode = None
        
        for node in unseenNodes:
            if minNode is None:
                minNode = node
            elif shortest_distance[node] < shortest_distance[minNode]:
                minNode = node
                
        for childNode, weight in graph[minNode].items():
            if weight + shortest_distance[minNode] < shortest_distance[childNode]:
                shortest_distance[childNode] = weight + shortest_distance[minNode]
                predecessor[childNode] = minNode
        
        unseenNodes.pop(minNode)
    
    currentNode = goal
    
    while currentNode != start:
        try:
            path.insert(0, currentNode)
            currentNode = predecessor[currentNode]
        except KeyError:
            ShortestPath_polyline = "Path not reachable"
            ShortestPath_indices = "Path not reachable"
            break

    if len(path) > 2:
        path.insert(0, start)
    else:
        path = [StartIndex, GoalIndex]

    return path


ShortestPath_indices = dijkstra(graph, start, goal)
# ---------- end ghpython_script_6 ----------
ghpython_script_7 = GhPythonScript(graph=data_dam_2, StartIndex=Slider(0, range=0..100), GoalIndex=Slider(999, range=0..1000))  # -> ShortestPath_indices; inputs StartIndex: Int32, GoalIndex: Int32; disabled
# ---------- ghpython_script_7: Python ----------
graph = eval(graph)
start = StartIndex
goal = GoalIndex

def dijkstra(graph, StartIndex, GoalIndex):
    shortest_distance = {}
    predecessor = {}
    unseenNodes = graph
    infinity = float("inf")
    path = []
    
    for node in unseenNodes:
        shortest_distance[node] = infinity
    
    shortest_distance[start] = 0
    
    while unseenNodes:
        minNode = None
        
        for node in unseenNodes:
            if minNode is None:
                minNode = node
            elif shortest_distance[node] < shortest_distance[minNode]:
                minNode = node
                
        for childNode, weight in graph[minNode].items():
            if weight + shortest_distance[minNode] < shortest_distance[childNode]:
                shortest_distance[childNode] = weight + shortest_distance[minNode]
                predecessor[childNode] = minNode
        
        unseenNodes.pop(minNode)
    
    currentNode = goal
    
    while currentNode != start:
        try:
            path.insert(0, currentNode)
            currentNode = predecessor[currentNode]
        except KeyError:
            ShortestPath_polyline = "Path not reachable"
            ShortestPath_indices = "Path not reachable"
            break

    if len(path) > 2:
        path.insert(0, start)
    else:
        path = [StartIndex, GoalIndex]

    return path

ShortestPath_indices = dijkstra(graph, StartIndex, GoalIndex)
# ---------- end ghpython_script_7 ----------
ghpython_script_8 = GhPythonScript(Gridsize=5, count=5)  # -> graph; inputs PointCloud: list of Point3d, Gridsize: Int32, count: Int32; same code as ghpython_script_5
ghpython_script_9 = GhPythonScript()  # -> ShortestPath_indices; inputs StartIndex: Int32, GoalIndex: Int32
# ---------- ghpython_script_9: Python ----------
import ghpythonlib.treehelpers as th
import ghpythonlib.parallel as parallel

graph = eval(graph)
start = StartIndex
goal = GoalIndex

def dijkstra(graph, StartIndex, GoalIndex):
    shortest_distance = {}
    predecessor = {}
    unseenNodes = graph
    infinity = float("inf")
    path = []
    
    for node in unseenNodes:
        shortest_distance[node] = infinity
    
    shortest_distance[start] = 0
    
    while unseenNodes:
        minNode = None
        
        for node in unseenNodes:
            if minNode is None:
                minNode = node
            elif shortest_distance[node] < shortest_distance[minNode]:
                minNode = node
                
        for childNode, weight in graph[minNode].items():
            if weight + shortest_distance[minNode] < shortest_distance[childNode]:
                shortest_distance[childNode] = weight + shortest_distance[minNode]
                predecessor[childNode] = minNode
        
        unseenNodes.pop(minNode)
    
    currentNode = goal
    
    while currentNode != start:
        try:
            path.insert(0, currentNode)
            currentNode = predecessor[currentNode]
        except KeyError:
            ShortestPath_polyline = "Path not reachable"
            ShortestPath_indices = "Path not reachable"
            break

    if len(path) > 2:
        path.insert(0, start)
    else:
        path = [StartIndex, GoalIndex]

    return path

ShortestPath_indices = dijkstra(graph, StartIndex, GoalIndex)
# ---------- end ghpython_script_9 ----------
