# Grasshopper definition Double_Curved_Surface_Image_Bi.gh (Grasshopper 1.0.7)

unit_y = UnitY(Factor=1)
u_divided_points = Slider(56, range=0..100)
v_divided_points = Slider(56, range=0..100)
curve_length = Slider(4, range=0..10)
point = Point(<point referenced from the Rhino model>)
vector = Vector(unit_y)
amount_segments = Slider(4, range=0..10)
domain_start = Slider(-5, range=-5..0)
domain_end = Slider(5, range=0..5)
line_sdl = LineSDL(Start=point, Direction=expr("-x", vector), Length=curve_length)
range = Range(Domain=Domain(0, 1), Steps=u_divided_points)
range_2 = Range(Domain=Domain(0, 1), Steps=v_divided_points)
u_direction = GraphMapper(flatten(range), x0=0, x1=1, y0=0, y1=1, container_name="Sine", Equation_px=[0, 0.3240873516], Equation_py=[0, 1])

# ---- group: V-direction
graph_mapper = GraphMapper(graft(range_2), x0=0, x1=1, y0=0, y1=1, container_name="Sine", Equation_px=[0, 0.3373280168], Equation_py=[0, 1])

# ----
divide_curve = DivideCurve(Curve=line_sdl, Count=amount_segments, Kinks=False)  # -> simplify(graft(Points)), Tangents, Parameters
construct_domain = ConstructDomain(DomainStart=domain_start, DomainEnd=domain_end)
range_3 = Range(Domain=Domain(0, 1), Steps=amount_segments)
x_size = Slider(40, range=0..100)
y_size = Slider(40, range=0..100)
graph_mapper_2 = GraphMapper(
    range_3,
    x0=0,
    x1=1,
    y0=0,
    y1=1,
    container_name="Sine Summation",
    Equation0_px=[0.2, 0.1081092507],
    Equation0_py=[0.2, 0.07854068279],
    Equation1_px=[0.6, 0.8716489077],
    Equation1_py=[0.3, 0.4977388978])
multiplication = Multiplication(A=u_direction, B=graph_mapper)

# ---- group: Place on ground
sort_list = SortList(Keys=flatten(multiplication))  # -> Keys, ValuesValuesA
list_item = ListItem(List=sort_list.Keys, Index=0, Wrap=True)
subtraction = Subtraction(A=multiplication, B=list_item)
stream_filter = StreamFilter(Gate=Toggle(True), Stream0=multiplication, Stream1=subtraction)

# ----
plane_surface = PlaneSurface(Plane=PlaneXY(0, 0, 0), XSize=x_size, YSize=y_size)
remap_numbers = RemapNumbers(Value=graph_mapper_2, Source=Domain(0, 1), Target=construct_domain)  # -> simplify(graft(Mapped)), Clipped
unit_x = UnitX(Factor=remap_numbers.Mapped)
move = Move(Geometry=divide_curve.Points, Motion=unit_x)  # -> flatten(Geometry), Transform
unit_z = UnitZ(Factor=1)
divide_surface = DivideSurface(Surface=plane_surface, UCount=u_divided_points, VCount=v_divided_points)  # -> Points, Normals, Parameters
construct_domain_2 = ConstructDomain(DomainStart=Slider(0, range=-10..0), DomainEnd=Slider(10, range=0..10))

# ---- group: Direction to extrude
vector_2 = Vector(unit_z)

# ----
interpolate = Interpolate(Vertices=move.Geometry, Degree=3, Periodic=False, KnotStyle=1)  # -> Curve, Length, Domain
remap_numbers_2 = RemapNumbers(Value=stream_filter, Source=Domain(0, 1), Target=construct_domain_2)  # -> Mapped, Clipped
multiplication_2 = Multiplication(A=vector_2, B=remap_numbers_2.Mapped)
move_2 = Move(Geometry=divide_surface.Points, Motion=multiplication_2)  # -> flatten(Geometry), Transform
maximum = Maximum(A=u_divided_points, B=v_divided_points)
surface_from_points = SurfaceFromPoints(Points=move_2.Geometry, UCount=expr("x+1", maximum), Interpolate=Toggle(True))
surface = Surface(reparameterize(surface_from_points))
u_count = Slider(100, range=0..100)
v_count = Slider(100, range=0..100)
surface_2 = Surface(surface)
min_height = Slider(0, range=0..1)
max_height = Slider(2.6, range=0..100)
percentage_i_r_t_height = Slider(15.8, range=0..40)
random_seed = Slider(8, range=0..10)
iterations_smoothing = Slider(2, range=0..10)
smooth_strength = Slider(1, range=0..1)
max_displacement = Slider(0.7, range=0..1)
create_material = CreateMaterial(
    Diffuse=ColourSwatch(SwatchColor=RGB(199, 193, 193)),
    Specular=RGB(255, 255, 255),
    Emission=RGB(0, 0, 0),
    Transparency=0,
    Shine=0)

# ---- group: Surface from bump map
divide_surface_2 = DivideSurface(Surface=surface_2, UCount=u_count, VCount=v_count)  # -> simplify(Points), Normals, Parameters
image_sampler = ImageSampler(
    divide_surface_2.Parameters,
    FilePath="C:\Users\Job de Vogel\Pictures\Heightmap.png",
    Filter="Value",
    Interpolate=False,
    Umax=1,
    Umin=0,
    Vmax=1,
    Vmin=0,
    Wrap=1)
construct_domain_3 = ConstructDomain(DomainStart=min_height, DomainEnd=max_height)
remap_numbers_3 = RemapNumbers(Value=image_sampler, Source=Domain(0, 1), Target=construct_domain_3)  # -> simplify(Mapped), Clipped

# ---- group: Random offset
multiplication_3 = Multiplication(A=max_height, B=percentage_i_r_t_height)
construct_domain_4 = ConstructDomain(DomainStart=expr("x*-0.01", multiplication_3), DomainEnd=expr("x*0.01", multiplication_3))
list_length = ListLength(List=flatten(remap_numbers_3.Mapped))
random = Random(Range=construct_domain_4, Number=list_length, Seed=random_seed)  # -> simplify(Random)
partition_list = PartitionList(List=random, Size=expr("x+1", v_count))  # -> simplify(Chunks)

# ---- group: Surface from bump map (continued)
addition = Addition(A=remap_numbers_3.Mapped, B=partition_list)
unit_z_2 = UnitZ(Factor=addition)
move_3 = Move(Geometry=divide_surface_2.Points, Motion=unit_z_2)  # -> flatten(Geometry), Transform
surface_from_points_2 = SurfaceFromPoints(Points=move_3.Geometry, UCount=expr("x+1", u_count), Interpolate=False)

# ---- group: Create mesh
mesh_brep = MeshBrep(
    Brep=surface_from_points_2,
    Settings={GridMaxCount=0, GridMinCount=16, JaggedSeams=False, MaxEdgeLength=0, MinEdgeLength=0.0001, MinTolerance=0, Refine=True, RefineAngle=0, RelativeTolerance=0.65, SimplePlanes=True, Tolerance=0})
triangulate = Triangulate(Mesh=mesh_brep)  # -> Mesh, Count
smooth_mesh = SmoothMesh(Mesh=triangulate.Mesh, Strength=smooth_strength, SkipNaked=True, Iterations=iterations_smoothing, Limit=max_displacement)

# ----
custom_preview = CustomPreview(Geometry=smooth_mesh, Material=create_material)
