# Grasshopper definition Grasshopper_Strava_API.gh (Grasshopper 1.0.7)
# Copyright: Job de Vogel

panel = Panel("""Name
id
type
start_date
distance
moving_time
average_speed
max_speed
elapsed_time
total_elevation_gain
kudos_count
map
summary_polyline""")
# Readme: README
# ------------
# Please create a Strava API Application: https://www.strava.com/settings/api
# -----
# Instructions can be found in CHAPTER ONE of: https://medium.com/swlh/using-python-to-connect-to-stravas-api-and-analyse-your-activities-dummies-guide-5f49727aac86
# -----
# Install the python polyline module
# https://pypi.org/project/polyline/
# 
# Download the .whl file and add it to Rhino>Tools>Edit>Tools>Options>Module Search Paths
# -----
# Install the python six module
# https://pypi.org/project/six/#files
# Same method as above
# ----
# Connect panels with the correct data from your Strava API Application to the input of the GetStravaData node, except for the initial url
# ----
# Generate an initial url by copying the following url to your browser and replace the client_id in the url.
# 
# https://www.strava.com/oauth/authorize?client_id=00000&redirect_uri=http://localhost&response_type=code&scope=activity:read_all
# 
# Authorize to get access
# 
# Your browser will probably give an error
# 
# Copy the new url that you see in your browser
# 
# Paste the url in a panel and give it to the initial_url input
# ----
# Select the columns you want to use from your Strava Data. All available columns are visible when holding your mouse on the Columns input
getstravadata = GhPythonScript(Run=Toggle(False), Columns=panel)  # -> msg, Data; inputs Run: Boolean, Client_id: Int32, Columns: list
# ---------- getstravadata: Python ----------
"""Provides a scripting component.
    Inputs:
        Run: Boolean that initiates the data retrieval from strava. Make sure you first add all other inputs before setting it to True.
        Name: The name of the athlete
        Client_id: Your personal client_id from your Strava API app
        Initial_url: Response url afther authorizing with the following link (please replace client_id=00000 with your own id) https://www.strava.com/oauth/authorize?client_id=00000&redirect_uri=http://localhost&response_type=code&scope=activity:read_all
        Columns: The Columns of data you would like to retrieve from Strava (resource_state, name, distance, moving_time, elapsed_time, total_elevation_gain, type, id, external_id, upload_id, start_date, start_date_local, timezone, utc_offset, start_latlng, end_latlng, location_city, location_state, location_country, start_latitude, start_longitude, achievement_count, kudos_count, comment_count, athlete_count, photo_count, trainer, commute	manual, private, visibility, flagged, gear_id, from_accepted_tag, upload_id_str, average_speed, max_speed, has_heartrate, heartrate_opt_out, display_hide_heartrate_option, elev_high, elev_low, pr_count, total_photo_count, has_kudoed, athlete.id, athlete.resource_state, map.id, map.summary_polyline,	map.resource_state,	workout_type, device_watts  NOTE: Some Columns are nested, for example: summary_polyline is nested in map. Please provide the parent name and child name of the column to retrieve the data.

    Output:
        msg: Did something went wrong? Some suggestions: renew your initial_url, did you turn the Run boolean to False before you gave the initial url as input?
        Data: The resulting individual data from Strava"""

#Credits to Benji Knights Johnson for providing the basis for this python code
#©2021. This work is licensed under a CC BY 4.0 license
ghenv.Component.Message = "Developed by Job de Vogel"

__author__ = "Job de Vogel"
__version__ = "2021.03.03"

from ghpythonlib import treehelpers as th
import urllib
import urllib2
import re
import json

#https://www.strava.com/oauth/authorize?client_id=00000&redirect_uri=http://localhost&response_type=code&scope=activity:read_all
def FilterActivity(Activity, Columns):
    ActivityResult = {}
    for column in Columns:
        for ActivityColumn in Activity:
            if str(column) == str(ActivityColumn):
                ActivityResult[column] = Activity[column]
                break
    return ActivityResult
 
def GetStravaData(Client_id, Client_secret, Initial_code, Columns):
    url = "https://www.strava.com/oauth/token"
    values = {
            'client_id': Client_id,
            'client_secret': str(Client_secret),
            'code': str(Initial_code),
            'grant_type': 'authorization_code'
            }
    
    data = urllib.urlencode(values)
    req = urllib2.Request(url, data)

    try:
        response = urllib2.urlopen(req)
    except:
        print("Your Initial_url has already been used")
    
    result = response.read()
    strava_tokens = json.loads(result)

    # Loop through all activities
    url = "https://www.strava.com/api/v3/activities"
    
    access_token = strava_tokens['access_token']
    
    # Get first page of activities from Strava with all fields
    req = urllib2.Request(url + '?access_token=' + access_token)
    response = urllib2.urlopen(req)
    result = response.read()
    
    r = json.loads(result)

    for i, activity in enumerate(r):
        r[i] = FilterActivity(activity, Columns)

    return r, strava_tokens

def Normalize(data):
    def recursiveKeyAdd(data, Result = None):
        if Result == None:
            Result = set()
        
        for k, v in data.items():
            if isinstance(v, dict):
                recursiveKeyAdd(v, Result)
            else:
                Result.add(k)
        return Result
    
    RestructuredDict = dict.fromkeys(recursiveKeyAdd(data[0]), [])

    for activity in data:        
        def recursiveValueAdd(activity, RestructuredDict):
            for k, v in activity.items():
                if isinstance(v, dict):
                    recursiveValueAdd(v, RestructuredDict)
                else:
                    #RestructuredData[str(k)].append(v)
                    RestructuredDict[k] = RestructuredDict.get(k) + [v]
            
            return RestructuredDict
        
        recursiveValueAdd(activity, RestructuredDict)
     
    RestructuredList = []
    for k in RestructuredDict:
        RestructuredList.append([k] + RestructuredDict[k])
    return RestructuredList

def CombineToJSON(data, Name):
    Result = []
    for i, JSON in enumerate(data):
        for activity in JSON:
            activity["Name"] = Name
            Result.append(activity)
    
    Result.reverse()
    
    Result = Normalize(Result)
    return Result

def GetInitialCode(url):
    return re.split("code=|&scope", url)[1]

def SortTree(Data, Columns):
    Result = []
    for data in Data:
        if data[:1] == "Name":
            Result.append(data)

    for col in Columns:
        for data in Data:
            if data[0] == col:
                Result.append(data)

    return Result

def main(Client_id, Client_secret, Initial_code, Name, Columns):
    Data = [GetStravaData(Client_id, Client_secret, Initial_code, Columns)[0]]
    Data = CombineToJSON(Data, Name)
    Data = SortTree(Data, Columns)
    return Data

if Run:
    #Localhost received url
    try:
        Initial_code = GetInitialCode(Initial_url)
    except:
        print("Your url is not correct!")
    Columns = Columns
    Data = th.list_to_tree(main(Client_id, Client_secret, Initial_code, Name, Columns))
# ---------- end getstravadata ----------

# ---- group: Extract Geo Data and create path polylines
list_item = ListItem(List=getstravadata.Data, Index=0, Wrap=True)  # -> flatten(Item)
# Readme: README
# -----
# This script extracts the summary_polyline from the map.summary_polyline column. To get this data, make sure you add both "map" and "summary_polyline" to your column input of the GetStravaData node.
getpathbytes = GhPythonScript(Data=simplify(getstravadata.Data), Categories=list_item)  # -> out, Paths; inputs Data: tree, Categories: list
# ---------- getpathbytes: Python ----------
"""Provides a scripting component.
    Inputs:
        Data: The retrieved data from strava, including the summary_polyline column
        Categories: The names of all columns of your strava Data (please flatten)
    Output:
        Paths: The paths in bytes"""

__author__ = "Job de Vogel"
__version__ = "2021.03.01"

from ghpythonlib import treehelpers as th

Data = th.tree_to_list(Data, None)

Paths = []
Names = []
for column in Data:
    if column[0] == "summary_polyline":
        for path in column[1:]:
            Paths.append(r'{}'.format(path))
        break
    if column[0] == "Name":
        for name in column[1:]:
            Names.append(name)
# ---------- end getpathbytes ----------
# Readme: README
# -----
# This script converts the Paths bytes to coordinate Longitudes and Lattitudes.
bytestocoordinates = GhPythonScript(Bytes=simplify(getpathbytes.Paths))  # -> out, Longitudes, Lattitudes; inputs Bytes: list
# ---------- bytestocoordinates: Python ----------
"""Provides a scripting component.
    Inputs:
        Bytes: The Paths data in bytes
    Output:
        Longitudes: The GPS Longitudes coordinates
        Lattitudes: The GPS Lattitudes coordinates"""

__author__ = "Job de Vogel"
__version__ = "2021.02.24"

import polyline
from ghpythonlib import treehelpers as th

def BytesToCoordinates(bytes):
    lo = []
    la = []
    
    bytes = r"" + bytes

    #split bytes in coordinates
    data = polyline.decode(bytes)
    for GeoLocation in data:
        GeoLocation = list(GeoLocation)
        la.append(float(GeoLocation[0]))
        lo.append(float(GeoLocation[1]))
    return lo, la

Longitudes = []
Lattitudes = []

for bytes in Bytes:
    coordinates = BytesToCoordinates(bytes)
    Longitudes.append(coordinates[0])
    Lattitudes.append(coordinates[1])

Longitudes = th.list_to_tree(Longitudes)
Lattitudes = th.list_to_tree(Lattitudes)
# ---------- end bytestocoordinates ----------
construct_point = ConstructPoint(XCoordinate=bytestocoordinates.Longitudes, YCoordinate=bytestocoordinates.Lattitudes, ZCoordinate=0)
# Readme: README
# -----
# Not visible? LMB on Polyline node > RMB on canvas > Zoom
polyline = PolyLine(Vertices=construct_point, Closed=False)
