# Grasshopper definition Time Explosion.gh (Grasshopper 1.0.7)
# Copyright: Job de Vogel
# plug-ins: Kangaroo Components

timer = Timer(Interval=1, TimerInterval=5, Target=counter)  # disabled
speed = Slider(1, range=0..5)
counter = Counter(Reset=Toggle(False))
maximum = Slider(100, range=0..2000)
minimum = Slider(0, range=0..100)
multiplication = Multiplication(A=counter, B=speed)
subtraction = Subtraction(A=maximum, B=minimum)
multiplication_2 = Multiplication(A=subtraction, B=2)
modulus = Modulus(A=multiplication, B=subtraction)
modulus_2 = Modulus(A=multiplication, B=multiplication_2)
addition = Addition(A=minimum, B=modulus)
negative = Negative(Value=modulus)
larger_than = LargerThan(FirstNumber=modulus_2, SecondNumber=subtraction)  # -> LargerThan, OrEqualTo
addition_2 = Addition(A=maximum, B=negative)
sphere = Sphere(Base=PlaneXY(0, 0, 0), Radius=Slider(1, range=0..100))
stream_filter = StreamFilter(Gate=larger_than.OrEqualTo, Stream0=addition, Stream1=addition_2)
up_and_down = Number(stream_filter)
up = Number(addition)
populate_geometry = PopulateGeometry(Geometry=sphere, Count=Slider(100, range=0..5000), Seed=2)
surface_closest_point = SurfaceClosestPoint(Point=populate_geometry, Surface=sphere)  # -> Point, UVPoint, Distance
number_slider = Slider(0.2, range=0..1)
evaluate_surface = EvaluateSurface(Surface=sphere, Point=surface_closest_point.UVPoint)  # -> Point, Normal, UDirection, VDirection, Frame
series = Series(Start=minimum, Step=number_slider, Count=maximum)
multiplication_3 = Multiplication(A=graft(evaluate_surface.Normal), B=series)
multiplication_4 = Multiplication(A=number_slider, B=maximum)
move = Move(Geometry=graft(populate_geometry), Motion=multiplication_3)  # -> Geometry, Transform
addition_3 = Addition(A=multiplication_4, B=minimum)
construct_domain = ConstructDomain(DomainStart=0, DomainEnd=addition_3)
construct_domain_2 = ConstructDomain(DomainStart=Slider(0.01, range=0..1), DomainEnd=Slider(0.001, range=0..1))
flip_matrix = FlipMatrix(Data=move.Geometry)
remap_numbers = RemapNumbers(Value=series, Source=construct_domain, Target=construct_domain_2)  # -> Mapped, Clipped

range = Range(Domain=Domain(0, 0.99), Steps=expr("x-1", maximum))

graph_mapper = GraphMapper(range, x0=0, x1=1, y0=0, y1=1, Gx=0.3611825705, Gy=0.6564462185, container_name="Power", power=0.4133210936)

multiplication_5 = Multiplication(A=maximum, B=graph_mapper)

list_item = ListItem(List=multiplication_5, Index=up, Wrap=True)
integer = Integer(list_item)
tree_branch = TreeBranch(Tree=simplify(flip_matrix), Path=integer, MaintainPaths=False)
deconstruct_vector = DeconstructVector(Vector=tree_branch)  # -> XComponent, YComponent, ZComponent
list_item_2 = ListItem(List=remap_numbers.Mapped, Index=integer, Wrap=True)
construct_point = ConstructPoint(
    XCoordinate=deconstruct_vector.XComponent,
    YCoordinate=deconstruct_vector.YComponent,
    ZCoordinate=deconstruct_vector.ZComponent)
cloud_display = CloudDisplay(Points=construct_point, Colours=RGB(15, 6, 11), Size=0.5, SpriteType=1)
