# Grasshopper definition Voxelgrid_Creator.gh (Grasshopper 1.0.7)
# Copyright: Job de Vogel
# plug-ins: MetaHopper

# ---- group: Point grid creation
number_slider = Slider(1, range=0..10)
center_box = CenterBox(Base=PlaneXY(0, 0, 0), X=expr("x/2", number_slider), Y=expr("x/2", number_slider), Z=expr("x/2", number_slider))
construct_point = ConstructPoint(XCoordinate=0, YCoordinate=0, ZCoordinate=0)
box_array = BoxArray(
    Geometry=construct_point,
    Cell=center_box,
    XCount=Slider(20, range=0..100),
    YCount=Slider(20, range=0..100),
    ZCount=Slider(20, range=0..100))  # -> Geometry, Transform

# ----
point_count = PointCount()  # Array count
goal_index = GoalIndex()
start_indices = StartIndices()
z_distance = ZDistance()  # Z distance of pointcloud
x_distance = XDistance()  # X distance of pointcloud
alpha = Alpha()
y_distance = YDistance()  # Y distance of pointcloud
gray_color = GrayColor()
parallel = Parallel()
group = Group()
number_slider_2 = Slider(210, range=0..1000)
number_slider_3 = Slider(550, range=0..1000)
number_slider_4 = Slider(255, range=0..255)
number_slider_5 = Slider(23, range=0..255)
number_slider_6 = Slider(6, range=0..10)

# ---- group: Point grid creation
number_slider_7 = Slider(10, range=0..100)
number_slider_8 = Slider(1, range=0..10)
number_slider_9 = Slider(10, range=0..100)
number_slider_10 = Slider(10, range=0..100)
center_box_2 = CenterBox(Base=PlaneXY(0, 0, 0), X=expr("x/2", point_count), Y=expr("x/2", point_count), Z=expr("x/2", point_count))
construct_point_2 = ConstructPoint(XCoordinate=0, YCoordinate=0, ZCoordinate=0)
box_array_2 = BoxArray(Geometry=construct_point_2, Cell=center_box_2, XCount=x_distance, YCount=y_distance, ZCount=z_distance)  # -> simplify(Geometry), Transform

# ----
boolean_toggle = BooleanToggle(True)

# ---- group: Voxel visualization
data_dam = DataDam(DataDataA=center_box, BufferDelay=10000000, BufferMode=0)
mesh_brep = MeshBrep(
    Brep=data_dam,
    Settings={GridMaxCount=0, GridMinCount=16, JaggedSeams=False, MaxEdgeLength=0, MinEdgeLength=0.0001, MinTolerance=0, Refine=True, RefineAngle=0, RelativeTolerance=0.65, SimplePlanes=True, Tolerance=0})
transform = Transform(Geometry=mesh_brep, Transform=box_array.Transform)

# ----
geometry = Geometry(box_array.Geometry)
data_dam_2 = DataDam(DataDataA=box_array.Geometry, BufferDelay=10000000, BufferMode=0)
mesh_brep_2 = MeshBrep(
    Brep=center_box_2,
    Settings={GridMaxCount=0, GridMinCount=16, JaggedSeams=False, MaxEdgeLength=0, MinEdgeLength=0.0001, MinTolerance=0, Refine=True, RefineAngle=0, RelativeTolerance=0.65, SimplePlanes=True, Tolerance=0})

# ---- group: Proximity calculation
proximity_3d = Proximity3D(Points=data_dam_2, Group=Slider(6, range=0..10), MaxRadius=number_slider)  # -> Links, Topology
list_item = ListItem(List=box_array.Geometry, Index=simplify(proximity_3d.Topology), Wrap=True)
list_length = ListLength(List=box_array.Geometry)  # -> expr("x-1", Length)
distance = Distance(PointA=graft(box_array.Geometry), PointB=list_item)
construct_domain = ConstructDomain(DomainStart=0, DomainEnd=list_length)
cp_distance = Data(distance)
cp_index = Data(proximity_3d.Topology)
range = Range(Domain=construct_domain, Steps=list_length)

# ----
transform_2 = Transform(Geometry=mesh_brep_2, Transform=box_array_2.Transform)  # -> simplify(Geometry)

# ---- group: Proximity calculation
proximity_3d_2 = Proximity3D(Points=box_array_2.Geometry, Group=group, MaxRadius=point_count)  # -> simplify(Links), Topology
list_item_2 = ListItem(List=box_array_2.Geometry, Index=simplify(proximity_3d_2.Topology), Wrap=True)
list_length_2 = ListLength(List=box_array_2.Geometry)  # -> expr("x-1", Length)
distance_2 = Distance(PointA=graft(box_array_2.Geometry), PointB=list_item_2)
construct_domain_2 = ConstructDomain(DomainStart=0, DomainEnd=list_length_2)
cp_distance_2 = Data(distance_2)
cp_index_2 = Data(proximity_3d_2.Topology)
range_2 = Range(Domain=construct_domain_2, Steps=list_length_2)

# ----
gene_pool = GenePool(
    Decimals=0,
    Maximum=8000,
    Minimum=0,
    Value=[6558.081593, 917.8373855, 5282.936084, 5125.373932, 6770.41098, 975.6507021, 5344.03327, 6928.822781, 7337.423268, 618.6])

# ---- group: Dijkstra
number_slider_11 = Slider(0, range=0..1000)  # disabled
number_slider_12 = Slider(0, range=0..23999)  # disabled
graphization = GhPythonScript(Points=simplify(range), CP_Indices=simplify(cp_index), Distances=simplify(cp_distance))  # -> graph; inputs Points: list of Int32, CP_Indices: tree of Int32, Distances: tree; disabled
# ---------- graphization: Python ----------
__author__ = "Job de Vogel"
__version__ = "2020.10.30"

import rhinoscriptsyntax as rs
import ghpythonlib.treehelpers as th

points = Points
closest_points = th.tree_to_list(CP_Indices , None)
distances = th.tree_to_list(Distances, None)
print(distances)
graph = {}

for pt in points:
    dict = {}
    for i, CP in enumerate(closest_points[pt]):
        dict[CP] = distances[pt][i]
    graph[pt] = dict

print(graph)
graph = str(graph)
# ---------- end graphization ----------
boolean_toggle_2 = BooleanToggle(True)  # disabled
dijkstra = GhPythonScript(graph=graphization, StartIndex=gene_pool, GoalIndex=number_slider_12, Parallel=boolean_toggle_2)  # -> ShortestPath_indices; inputs StartIndex: list of Int32, GoalIndex: Int32, Parallel: Boolean; disabled
# ---------- dijkstra: Python ----------
import ghpythonlib.treehelpers as th
import ghpythonlib.parallel as parallel
import copy

graph = eval(graph) ##input from Grasshopper
goal = GoalIndex    ##input from Grasshopper

def dijkstra(start):
    shortest_distance = {}
    predecessor = {}
    unseenNodes = copy.deepcopy(graph)
    infinity = float("inf")
    path = []
    
    for node in unseenNodes:
        shortest_distance[node] = infinity
    
    shortest_distance[start] = 0
    
    while unseenNodes:
        minNode = None
        
        for node in unseenNodes:
            if minNode is None:
                minNode = node
            elif shortest_distance[node] < shortest_distance[minNode]:
                minNode = node
                
        for childNode, weight in graph[minNode].items():
            if weight + shortest_distance[minNode] < shortest_distance[childNode]:
                shortest_distance[childNode] = weight + shortest_distance[minNode]
                predecessor[childNode] = minNode
        
        unseenNodes.pop(minNode)
    
    currentNode = goal
    
    while currentNode != start:
        try:
            path.insert(0, currentNode)
            currentNode = predecessor[currentNode]
        except KeyError:
            ShortestPath_polyline = "Path not reachable"
            ShortestPath_indices = "Path not reachable"
            break
    path.insert(0, start)

    return path

if Parallel:
    paths = parallel.run(dijkstra, StartIndex, False)
    ShortestPath_indices = th.list_to_tree(paths, True, [0])
else:
    paths = []
    for index in StartIndex:
        paths.append(dijkstra(index))
    ShortestPath_indices = th.list_to_tree(paths, True, [0])
# ---------- end dijkstra ----------
curve_drawer = GhPythonScript(PointCloud=box_array.Geometry, ShortestPath_indices=dijkstra)  # -> Path; inputs PointCloud: list of Point3d, ShortestPath_indices: list of Int32; disabled
# ---------- curve_drawer: Python ----------
import rhinoscriptsyntax as rs
import ghpythonlib as gh

PC = PointCloud
SPI = ShortestPath_indices

points = []

def CreatePolyline(PC, SPI):
    for int in ShortestPath_indices:
        points.append(PC[int])
    return points

Path = rs.AddPolyline(CreatePolyline(PC, SPI))
# ---------- end curve_drawer ----------
group_toggle = GroupToggle(ToggleActive=True, ToggleVisible=False)  # disabled

# ----
graphization_2 = GhPythonScript(Points=simplify(range_2), CP_Indices=simplify(cp_index_2), Distances=simplify(cp_distance_2))  # -> graph; inputs Points: list of Int32, CP_Indices: tree of Int32, Distances: tree
# ---------- graphization_2: Python ----------
__author__ = "Job de Vogel"
__version__ = "2020.10.30"

import rhinoscriptsyntax as rs
import ghpythonlib.treehelpers as th

points = Points
closest_points = th.tree_to_list(CP_Indices , None)
distances = th.tree_to_list(Distances, None)

graph = {}

for pt in points:
    dict = {}
    for i, CP in enumerate(closest_points[pt]):
        dict[CP] = distances[pt][i]
    graph[pt] = dict

print(graph)
graph = str(graph)
# ---------- end graphization_2 ----------
dijkstra_2 = GhPythonScript(graph=graphization_2, StartIndex=start_indices, GoalIndex=goal_index, Parallel=parallel)  # -> simplify(ShortestPath_indices); inputs StartIndex: list of Int32, GoalIndex: Int32, Parallel: Boolean; same code as dijkstra
curve_drawer_2 = GhPythonScript(PointCloud=box_array_2.Geometry, ShortestPath_indices=dijkstra_2)  # -> Path; inputs PointCloud: list of Point3d, ShortestPath_indices: list of Int32; same code as curve_drawer

# ---- group: Path visualization
number_slider_13 = Slider(23, range=0..255)
pipe = Pipe(Curve=curve_drawer, Radius=expr("x*0.05", number_slider), Caps=2)
mesh_brep_3 = MeshBrep(
    Brep=pipe,
    Settings={GridMaxCount=0, GridMinCount=16, JaggedSeams=False, MaxEdgeLength=0, MinEdgeLength=0.0001, MinTolerance=0, Refine=True, RefineAngle=0, RelativeTolerance=0.65, SimplePlanes=True, Tolerance=0})
colour_rgb = ColourRGB(Alpha=Slider(255, range=0..255), Red=number_slider_13, Green=number_slider_13, Blue=number_slider_13)
custom_preview = CustomPreview(Geometry=mesh_brep_3, Material=colour_rgb)

# ----
pipe_2 = Pipe(Curve=curve_drawer_2, Radius=expr("x*0.05", point_count), Caps=2)  # -> simplify(Pipe)
mesh_brep_4 = MeshBrep(
    Brep=pipe_2,
    Settings={GridMaxCount=0, GridMinCount=16, JaggedSeams=False, MaxEdgeLength=0, MinEdgeLength=0.0001, MinTolerance=0, Refine=True, RefineAngle=0, RelativeTolerance=0.65, SimplePlanes=True, Tolerance=0})
colour_rgb_2 = ColourRGB(Alpha=alpha, Red=gray_color, Green=gray_color, Blue=gray_color)
custom_preview_2 = CustomPreview(Geometry=mesh_brep_4, Material=colour_rgb_2)
geometry_2 = Geometry(pipe_2)
mesh = Mesh(transform_2)
geometry_3 = Geometry(box_array_2.Geometry)
data = Data(dijkstra_2)
line = Line(proximity_3d_2.Links)
points = Points(geometry_3)  # Points of pointcloud
shortest_path_indices = ShortestPathIndices(data)  # The point indices of the shortest path
shortest_path_visualization = ShortestPathVisualization(geometry_2)  # A visualization of the shortest path
mesh_voxels = MeshVoxels(mesh)  # A mesh of all voxels out of pointcloud
links = Links(line)  # The neighbors of all points
