# Grasshopper definition Wallacei_Box.gh (Grasshopper 1.0.7)
# Copyright: Job de Vogel
# plug-ins: Wallacei

wlc_xy = Slider(220, range=0..360)
wlc_yz = Slider(353, range=0..360)
wlc_zx = Slider(48, range=0..360)
geometry = Geometry(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)

# ---- group: Calculation
xy_plane = XYPlane(Origin=Point(0, 0, 0))
yz_plane = YZPlane(Origin=Point(0, 0, 0))
xz_plane = XZPlane(Origin=Point(0, 0, 0))
merge = Merge(Data1=wlc_xy, Data2=wlc_yz, Data3=wlc_zx)
merge_2 = Merge(Data1=xy_plane, Data2=yz_plane, Data3=xz_plane)
rotate = Rotate(Angle=degrees(merge), Plane=merge_2)  # -> Geometry, Transform
compound = Compound(Transforms=rotate.Transform)
transform = Transform(Geometry=geometry, Transform=compound)
bounding_box = BoundingBox(Content=transform, Plane=PlaneXY(0, 0, 0), UnionBox=False)  # -> Box, Box_2
volume = Volume(Geometry=bounding_box.Box)  # -> Volume, Centroid
deconstruct_brep = DeconstructBrep(Brep=bounding_box.Box)  # -> Faces, Edges, Vertices
list_item = ListItem(List=deconstruct_brep.Vertices, Index=0, Wrap=True)
list_item_2 = ListItem(List=deconstruct_brep.Faces, Index=0, Wrap=True)
minimize_volume = Panel(volume.Volume)
area = Area(Geometry=list_item_2)  # -> Area, Centroid
brep_closest_point = BrepClosestPoint(Point=list_item, Brep=transform)  # -> Point, Normal, Distance
line = Line(StartPoint=list_item, EndPoint=brep_closest_point.Point)
mimimize_surface_area = Panel(area.Area)
corner_le = Panel(brep_closest_point.Distance)
one_over_x = OneOverX(Value=brep_closest_point.Distance)
maximize_corner_length = Panel(one_over_x)
wlc_min_volume = Number(minimize_volume)
wlc_min_area = Number(mimimize_surface_area)
wlc_max_length = Number(maximize_corner_length)

# ---- group: Preview
mesh = Mesh(transform)
box = Box(bounding_box.Box)
create_material = CreateMaterial(
    Diffuse=ColourSwatch(SwatchColor=RGB(255, 255, 255)),
    Specular=RGB(255, 255, 255),
    Emission=RGB(0, 0, 0),
    Transparency=0.3,
    Shine=0)
custom_preview = CustomPreview(Geometry=box, Material=create_material)

# ----
wallacei_x = WallaceiX(
    Genes=[wlc_xy, wlc_yz, wlc_zx],
    Objectives=[wlc_max_length, wlc_min_area, wlc_min_volume],
    allFitness="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",
    allFrontIdx="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",
    allGenomes="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",
    curFrontIdx="99|0;99|1;99|2;99|3;99|4;99|5;99|6;99|7;99|8;99|9;99|10;99|11;99|12;99|13;99|14;99|15;99|16;99|17;99|18;99|19;99|20;99|21;99|22;99|23;99|24;99|25;99|26;99|27;99|28;99|29;99|30;99|31;99|32;99|33;99|34;99|35;99|36;99|37;99|38;99|39;99|40;99|41;99|42;99|43;99|44;99|45;99|46;99|47;99|48;99|49",
    curFrontIdxSave="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",
    popGen="50,100",
    total="606531",
    wlcDone=True)  # -> WallaceiGenomes, FitnessValues, Data, Phenotypes

# ---- group: Generate Grid
tree_statistics = TreeStatistics(Tree=wallacei_x.Phenotypes)  # -> Paths, Length, Count
fitness_to_sort = Slider(1, range=0..2)
tree_branch = TreeBranch(Tree=wallacei_x.FitnessValues, Path=tree_statistics.Paths, MaintainPaths=True)
list_item_3 = ListItem(List=tree_branch, Index=fitness_to_sort, Wrap=True)  # -> Item, Item1, Item2
sort_list = SortList(
    Keys=flatten(list_item_3.Item),
    ValuesValuesA=flatten(list_item_3.Item1),
    ValuesA=flatten(list_item_3.Item2),
    ValuesB=flatten(wallacei_x.Phenotypes))  # -> graft(Keys), graft(ValuesValuesA), graft(ValuesA), graft(ValuesB)
merge_3 = Merge(Data1=sort_list.Keys, Data2=sort_list.ValuesValuesA, Data3=sort_list.ValuesA)
x_size = Slider(300, range=0..1000)
y_size = Slider(300, range=0..1000)
distribute_to_grid = DistributeToGrid(
    FitnessValues=merge_3,
    WallaceiPhenotypes=sort_list.ValuesB,
    SizeOfTheGridInTheXDirection=x_size,
    SizeOfTheGridInTheYDirection=y_size,
    OutputOptions=0)  # -> DistributedFitnessValues, DistributedData, DistributedGeometries, DistributedMeshes, DistributedNumbers, GridLocations
